vi "index.gviweb"   [G Web Development Software 22.3.0]
panel controls:
  "Usuario": string
  "Contraseña": string
  "Confirm Button": bool
  "Logo3G_Image": string = "Image/LOGO%202024%20V3%20205X50.png"
  "Logo3G_Image_2": string = "Image/LOGO%202024%20V3%20205X50.png"
  "Logo3G_Image_3": string = "Image/LOGO%202024%20V3%20205X50.png"
  "LogoEecol_Image_3": string = "Image/EECOL%20LOGO%20156X50.png"
  "LogoLF_Image_3": string = "Image/LITELLFUSE%20201X50.png"
  "LogoPHOC_Image_3": string = "Image/PHOENIX%20CONTACT%20LOGO%20196X50.png"
  "Panel_Image_2": string = "Image/CDC%20ABB%2001%20450X290.png"
  "SmartPhone": bool
  "LogoEecol_Image_5": string = "Image/EECOL%20LOGO%20156X50.png"
  "Tab_2": i32
  "Logo3G_Image_4": string = "Image/LOGO%202024%20V3%20205X50.png"
  "Tab_3": i32
panel indicators:
  "Tab": i32
  "ELECTRIC ENERGY (kWh)": waveform<f64>
  "URL Image_4": string
  "URL Image_6": string
  "URL Image_7": string
  "S2 LoS Max": f64
  "S4 LoS Max": f64
  "loop iteration": i32
  "loop iteration_2": i32
  "Fecha | Hora": string
  "Server Active": bool
  "URL Image": string
  "CURRENT (A)": waveform<f32>
  "data cluster 1": T1
  "URL Image_2": string
  "data cluster 2": T2
  "ACTIVE POWER [kW]": waveform<f32>
  "APPARENT POWER (kVA)": waveform<f32>
  "TEMPERATURE [°C]": waveform<f64>
  "HUMIDITY [%]": waveform<f64>
  "data cluster 3": T3
  "TEMPERATURE [°C]_2": waveform<f64>
  "HUMIDITY [%]_2": waveform<f64>
  "CURRENT (A)_2": waveform<f32>
  "ELECTRIC ENERGY (kWh)_2": waveform<f64>
  "ACTIVE POWER [kW]_2": waveform<f32>
  "APPARENT POWER (kVA)_2": waveform<f32>
types:
  T1 = cluster{"phase voltage (V)": f32, "phase current (A)": f32, "phase frequency (Hz)": f32, "phase active power (kW)": f32, "phase apparent power (KVA)": f32, "phase power factor": f32}
  T2 = cluster{"active electric energy (kWh)": f64, "valor instantáneo (clp)": f64}
  T3 = cluster{"temperatura (°C)": f64, "humedad (%)": f64}
  T4 = cluster{"fractional second": f64, "second": i32, "minute": i32, "hour": i32, "day of month": i32, "month": i32, "year": i32, "day of week": i32, "day of year": i32, "DST": i32}
  T5 = cluster{"Date | Time": string, "date time": T4, "data cluster 1": T1, "data cluster 2": T2, "app-active": bool, "data cluster 3": T3}
uses:
  NI::HTTP::Open HTTP Handle.gvi
  NI::HTTP::GET.gvi
  NI::HTTP::PUT Buffer.gvi
  NI::HTTP::Close HTTP Handle.gvi
diagram:
  disable {
    frame Enabled { }
    frame Disabled { }
  }
  sequence {
    frame 0 {
      Property Node(instance in=reference to "Usuario", "Value"="")
      Property Node(instance in=reference to "Contraseña", "Value"="")
      Property Node(instance in=reference to unnamed text, "Visible"=FALSE)
      $Tab <- 0
    }
  }
  call "Open HTTP Handle.gvi"(error in=no error) -> (client handle out=w1, error out=w2)
  s1 = w2  # shift register
  s2 = w1  # shift register
  while {
    Wait(time to wait=250)
    w3 = cluster{"user": string, "password": string} {all zero or empty}
    w4 = "https://energy-monitoring-demo-default-rtdb.firebaseio.com/access.json"
    call "GET.gvi"(client handle=s2, url=w4, error in=s1) -> (client handle out=w5, body=w6, error out=w7)
    Unflatten From Json(JSON string=w6, type and defaults=w3) -> (value=w8)
    case ($"Confirm Button") {
      frame False, Default {
        w9 = FALSE
        w10 = FALSE
      }
      frame True {
        Property Node(instance in=w8) -> ("user"=w11, "password"=w12)
        Is Equal(x=$Usuario, y=w11) -> w13
        Is Equal(x=w12, y=$Contraseña) -> w14
        Logical And(w13, w14) -> w9
        case (w9) {
          frame True {
            Property Node(instance in=reference to unnamed text, "Visible"=FALSE)
          }
          frame False {
            Property Node(instance in=reference to unnamed text, "Visible"=TRUE)
          }
        }
        w10 = $SmartPhone
      }
    }
    next s1 = w7
    next s2 = w5
    stop if w9
  }
  w15 = T5 {all zero or empty}  # data-send
  Obtain Queue(element data type=w15, error in=s1, max queue size=50) -> (error out=w16, queue out=w17)
  s3 = s2  # shift register
  s4 = s1  # shift register
  s5 = w16  # shift register
  while (iteration -> i1) {
    Wait(time to wait=200)
    case (w10) {
      frame False, Default {
        w18 = 1
      }
      frame True {
        w18 = 1
      }
    }
    $Tab <- w18
    disable {
      frame Enabled {
        w19 = s4
        w20 = s3
      }
      frame Disabled {
        w21 = "https://arc-flash-relay-default-rtdb.firebaseio.com/data-read.json"
        Property Node(instance in=cluster{"Reset": bool} {all zero or empty}) -> (instance out=w22)
        Flatten To Json(anything=w22) -> (JSON string=w23)
        call "PUT Buffer.gvi"(client handle=s3, url=w21, buffer=w23, error in=s4) -> (client handle out=w20, error out=w19)
        Wait(time to wait=100)
        Wait(time to wait=50)
      }
    }
    w24 = "https://energy-monitoring-demo-default-rtdb.firebaseio.com/data-send.json"
    call "GET.gvi"(client handle=w20, url=w24, error in=w19) -> (client handle out=w25, body=w26, error out=w27)
    Unflatten From Json(JSON string=w26, type and defaults=w15) -> (value=w28)
    Enqueue Element(element=w28, error in=s5, queue=w17) -> (error out=w29)
    $"loop iteration" <- i1
    next s3 = w25
    next s4 = w27
    next s5 = w29
    stop if FALSE
  }
  call "Close HTTP Handle.gvi"(client handle=s3, error in=s4)
  Release Queue(error in=s5, queue=w17)
  while (iteration -> i2) {
    Dequeue Element(queue=w17) -> (element=w30, error out=w31)
    case (w31) {
      frame Error, Default {
        w32 = TRUE
      }
      frame No Error {
        Property Node(instance in=w30) -> ("app-active"=w33, "data cluster 1:phase current (A)"=w34, "data cluster 2:active electric energy (kWh)"=w35, "data cluster 1:phase active power (kW)"=w36, "data cluster 1:phase apparent power (KVA)"=w37, "data cluster 3:temperatura (°C)"=w38, "data cluster 3:humedad (%)"=w39, "date time"=w40, "data cluster 1"=w41, "data cluster 2"=w42, "data cluster 3"=w43)
        $"Server Active" <- w33
        Get Current Time() -> (current time=w44)
        Get Date And Time String(time stamp=w44) -> (date string=w45, time string=w46)
        Concatenate Strings(w45, " | ", w46) -> w47
        $"Fecha | Hora" <- w47
        Build Array(w35) -> w48
        Build Waveform Node(Y=w48, dt=1, t0=w44) -> (output waveform=w49)
        $"ELECTRIC ENERGY (kWh)" <- w49
        $"ELECTRIC ENERGY (kWh)_2" <- w49
        Date And Time To Timestamp(date time rec=w40)
        Build Array(w34) -> w50
        Build Waveform Node(Y=w50, dt=1, t0=w44) -> (output waveform=w51)
        $"CURRENT (A)" <- w51
        $"CURRENT (A)_2" <- w51
        Build Array(w36) -> w52
        Build Waveform Node(Y=w52, dt=1, t0=w44) -> (output waveform=w53)
        $"ACTIVE POWER [kW]" <- w53
        $"ACTIVE POWER [kW]_2" <- w53
        Build Array(w37) -> w54
        Build Waveform Node(Y=w54, dt=1, t0=w44) -> (output waveform=w55)
        $"APPARENT POWER (kVA)" <- w55
        $"APPARENT POWER (kVA)_2" <- w55
        Build Array(w38) -> w56
        Build Waveform Node(Y=w56, dt=1, t0=w44) -> (output waveform=w57)
        $"TEMPERATURE [°C]" <- w57
        $"TEMPERATURE [°C]_2" <- w57
        Build Array(w39) -> w58
        Build Waveform Node(Y=w58, dt=1, t0=w44) -> (output waveform=w59)
        $"HUMIDITY [%]" <- w59
        $"HUMIDITY [%]_2" <- w59
        $"data cluster 1" <- w41
        $"data cluster 2" <- w42
        $"data cluster 3" <- w43
        w32 = FALSE
      }
    }
    Wait(time to wait=200)
    $"loop iteration_2" <- i2
    stop if w32
  }
