vi "index_2.gviweb"   [G Web Development Software 22.3.0]
panel controls:
  "Usuario": string
  "Contraseña": string
  "Confirm Button": bool
  "Logo3G_Image": string = "Image/LOGO%202024%20V3%20205X50.png"
  "Logo3G_Image_2": string = "Image/LOGO%202024%20V3%20205X50.png"
  "Logo3G_Image_3": string = "Image/LOGO%202024%20V3%20205X50.png"
  "LogoEecol_Image_3": string = "Image/EECOL%20LOGO%20156X50.png"
  "LogoLF_Image_3": string = "Image/LITELLFUSE%20201X50.png"
  "LogoPHOC_Image_3": string = "Image/PHOENIX%20CONTACT%20LOGO%20196X50.png"
  "Panel_Image_2": string = "Image/CDC%20ABB%2001%20450X290.png"
  "SmartPhone": bool
  "LogoEecol_Image_5": string = "Image/EECOL%20LOGO%20156X50.png"
  "Tab_2": i32
  "Logo3G_Image_4": string = "Image/LOGO%202024%20V3%20205X50.png"
  "Logo3G_Image_5": string = "Image/LOGO%202024%20V3%20205X50.png"
  "BA-01_2": bool
  "BA-01_3": bool
panel indicators:
  "body": string
  "Tab": i32
  "TK-01": cluster{"Element 1": f64}
  "Light on Sensor 3 Max": cluster{"Element 1": f64, "Element 2": f64}
  "URL Image_4": string
  "body_2": string
  "URL Image_6": string
  "URL Image_7": string
  "S2 LoS Max": f64
  "S4 LoS Max": f64
  "loop iteration": i32
  "TANK-01": string
  "TK-01_2": f64
  "HL": bool
  "LL": bool
  "EV-01": bool
  "BA-01": bool
  "BA-02": bool
  "Href_1": f64
  "Href_2": f64
  "AG-01": bool
  "loop iteration_2": i32
  "CP-TK-01": bool
types:
  T1 = cluster{"level-tank": f64, "BA-01c": bool, "Href_1": f64, "BA-02c": bool, "HR-01": bool, "LR-01": bool, "Lref_1": f64}
uses:
  NI::HTTP::Open HTTP Handle.gvi
  NI::HTTP::GET.gvi
  NI::HTTP::PUT Buffer.gvi
  NI::HTTP::Close HTTP Handle.gvi
diagram:
  disable {
    frame Enabled { }
    frame Disabled { }
  }
  sequence {
    frame 0 {
      Property Node(instance in=reference to "Usuario", "Value"="")
      Property Node(instance in=reference to "Contraseña", "Value"="")
      Property Node(instance in=reference to unnamed text, "Visible"=FALSE)
      $Tab <- 0
    }
  }
  call "Open HTTP Handle.gvi"(error in=no error) -> (client handle out=w1, error out=w2)
  s1 = w2  # shift register
  s2 = w1  # shift register
  while {
    Wait(time to wait=250)
    w3 = cluster{"user": string, "password": string} {all zero or empty}
    w4 = "https://level-tank-demo-default-rtdb.firebaseio.com/access.json"
    call "GET.gvi"(client handle=s2, url=w4, error in=s1) -> (client handle out=w5, body=w6, error out=w7)
    Unflatten From Json(JSON string=w6, type and defaults=w3) -> (value=w8)
    case ($"Confirm Button") {
      frame False, Default {
        w9 = FALSE
        w10 = FALSE
      }
      frame True {
        Property Node(instance in=w8) -> ("user"=w11, "password"=w12)
        Is Equal(x=$Usuario, y=w11) -> w13
        Is Equal(x=w12, y=$Contraseña) -> w14
        Logical And(w13, w14) -> w9
        case (w9) {
          frame True {
            Property Node(instance in=reference to unnamed text, "Visible"=FALSE)
          }
          frame False {
            Property Node(instance in=reference to unnamed text, "Visible"=TRUE)
          }
        }
        w10 = $SmartPhone
      }
    }
    next s1 = w7
    next s2 = w5
    stop if w9
  }
  Obtain Queue(element data type=T1 {all zero or empty}, error in=s1, max queue size=10) -> (error out=w15, queue out=w16)
  s3 = s2  # shift register
  s4 = s1  # shift register
  s5 = w15  # shift register
  while (iteration -> i1) {
    disable {
      frame Enabled {
        w17 = s4
        w18 = s3
      }
      frame Disabled {
        w19 = "https://arc-flash-relay-default-rtdb.firebaseio.com/data-read.json"
        Property Node(instance in=cluster{"Reset": bool} {all zero or empty}) -> (instance out=w20)
        Flatten To Json(anything=w20) -> (JSON string=w21)
        call "PUT Buffer.gvi"(client handle=s3, url=w19, buffer=w21, error in=s4) -> (client handle out=w18, error out=w17)
        Wait(time to wait=100)
        Wait(time to wait=50)
      }
    }
    w22 = "https://level-tank-demo-default-rtdb.firebaseio.com/data-send.json"
    call "GET.gvi"(client handle=w18, url=w22, error in=w17) -> (client handle out=w23, body=w24, error out=w25)
    $body <- w24
    $body_2 <- w24
    case (w10) {
      frame False, Default {
        w26 = 1
      }
      frame True {
        w26 = 1
      }
    }
    $Tab <- w26
    Unflatten From Json(JSON string=w24, type and defaults=T1 {all zero or empty}) -> (value=w27)
    Enqueue Element(element=w27, error in=s5, queue=w16, timeout in ms=1000) -> (error out=w28)
    $"loop iteration" <- i1
    next s3 = w23
    next s4 = w25
    next s5 = w28
    stop if FALSE
  }
  call "Close HTTP Handle.gvi"(client handle=s3, error in=s4)
  Release Queue(error in=s5, queue=w16)
  while (iteration -> i2) {
    Dequeue Element(queue=w16, timeout in ms=1000) -> (element=w29, error out=w30)
    case (w30) {
      frame Error, Default {
        w31 = TRUE
      }
      frame No Error {
        Property Node(instance in=w29) -> ("level-tank"=w32, "BA-01c"=w33, "BA-02c"=w34, "HR-01"=w35, "LR-01"=w36, "Href_1"=w37, "Lref_1"=w38)
        $"TK-01_2" <- w32
        $"BA-01" <- w33
        $"BA-02" <- w34
        $HL <- w35
        $LL <- w36
        $Href_1 <- w37
        $Href_2 <- w38
        Build Cluster(w32) -> w39
        $"TK-01" <- w39
        w31 = FALSE
      }
    }
    $"loop iteration_2" <- i2
    stop if w31
  }
